# Grasshopper definition 根据点云的地形建模.gh (Grasshopper 1.0.7)

point = Point([<point referenced from the Rhino model> x5000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])
delaunay_mesh = DelaunayMesh(Points=point, Plane=PlaneXY(0, 0, 0))
smooth_mesh = SmoothMesh(Mesh=delaunay_mesh, Strength=0.5, SkipNaked=True, Iterations=Slider(3, range=0..10))
deconstruct = Deconstruct(Point=point)  # -> XComponent, YComponent, ZComponent
panel = Panel(deconstruct.ZComponent)
number_slider = Slider(75, range=0..100)
patch = Patch(Points=point, Spans=20, Flexibility=1, Trim=True)
bounds = Bounds(Numbers=deconstruct.ZComponent)
panel_2 = Panel(bounds)
division = Division(A=deconstruct.ZComponent, B=Slider(62, range=0..100))
mesh_surface = MeshSurface(Surface=patch, UCount=number_slider, VCount=number_slider, Overhang=True, Equalize=False)
deconstruct_domain = DeconstructDomain(Domain=bounds)  # -> expr("x/100", Start), expr("x/100", End)
construct_point = ConstructPoint(XCoordinate=0, YCoordinate=0, ZCoordinate=deconstruct_domain.Start)
contour = Contour(Shape=mesh_surface, Point=construct_point, Direction=Vector(0, 0, 1), Distance=Slider(2.1, range=0..10))
gradient = Gradient(
    LowerLimit=deconstruct_domain.End,
    UpperLimit=deconstruct_domain.Start,
    Parameter=division,
    stops=[0: RGB(255, 69, 0), 0.123: RGB(255, 250, 205), 0.363: RGB(128, 255, 128), 0.587: RGB(192, 255, 255), 0.765: RGB(0, 0, 205)])
panel_3 = Panel(contour)
panel_4 = Panel(gradient)
mesh_colours = MeshColours(Mesh=smooth_mesh, Colours=gradient)
